# Grasshopper definition GD2 Visitor Centre Model Final.gh (Grasshopper 1.0.8)
# plug-ins: GSA, Weaverbird

radius_of_gridshell_roof = Slider(12, range=0..50)
number_of_struts = Slider(6, range=0..10)
radial_divisions = Slider(18, range=0..40)
circumfrential_divisions = Slider(7, range=0..20)
height_of_gridshell_roof_above_ground = Slider(5, range=0..20)
height_of_gridshell_roof = Slider(4, range=0..20)
inner_circle_radius = Slider(2.5, range=0..10)
strut_node_connection = Slider(0, range=0..5)
inner_intermediate_point = Slider(9, range=0..50)
outer_intermediate_point = Slider(9, range=0..50)
height_of_central_column = Slider(6.3, range=0..20)
panel = Panel("base parameters")
addition = Addition(A=height_of_gridshell_roof_above_ground, B=height_of_gridshell_roof)

pt = ConstructPoint(XCoordinate=inner_intermediate_point, YCoordinate=0, ZCoordinate=addition)
pt_2 = ConstructPoint(XCoordinate=0, YCoordinate=0, ZCoordinate=addition)
pt_3 = ConstructPoint(XCoordinate=outer_intermediate_point, YCoordinate=0, ZCoordinate=height_of_gridshell_roof_above_ground)
pt_4 = ConstructPoint(XCoordinate=radius_of_gridshell_roof, YCoordinate=0, ZCoordinate=height_of_gridshell_roof_above_ground)
panel_2 = Panel("Roof Shape")
nurbs = NurbsCurve(Vertices=[pt_2, pt, pt_3, pt_4], Degree=3, Periodic=False)  # -> Curve, Length, Domain

neg = Negative(Value=radius_of_gridshell_roof)
num = Number(radius_of_gridshell_roof)
pt_5 = ConstructPoint(XCoordinate=num, YCoordinate=neg, ZCoordinate=0)
pt_6 = ConstructPoint(XCoordinate=neg, YCoordinate=neg, ZCoordinate=0)
pt_7 = ConstructPoint(XCoordinate=num, YCoordinate=num, ZCoordinate=0)
pt_8 = ConstructPoint(XCoordinate=neg, YCoordinate=num, ZCoordinate=0)
panel_3 = Panel("floor")
srf4pt = _4PointSurface(CornerA=pt_7, CornerB=pt_8, CornerC=pt_6, CornerD=pt_5)
rgb = ColourRGB(Alpha="200", Red="89", Green="83", Blue="53")
preview = CustomPreview(Geometry=srf4pt, Material=rgb)

pt_9 = ConstructPoint(XCoordinate=0, YCoordinate=0, ZCoordinate=addition)
division = Division(A="2*pi", B=radial_divisions)
cir = Circle(Plane=pt_9, Radius=inner_circle_radius)
series = Series(Start=0, Step=division, Count=radial_divisions)
xy = XYPlane(Origin=Point(0, 0, 0))
panel_4 = Panel("Gridshell Creation")
trim = TrimWithRegions(Curve=nurbs.Curve, Regions=cir, Plane=xy)  # -> Inside, Outside
divide = DivideCurve(Curve=trim.Outside, Count=circumfrential_divisions, Kinks=False)  # -> Points, Tangents, Parameters
shift = ShiftList(List=divide.Points, Shift=1, Wrap="false")
pt_10 = Point(Point(0, 0, 0))
pt_11 = Point(Point(0, 0, 1))
ln = Line(StartPoint=divide.Points, EndPoint=shift)
ln_2 = Line(StartPoint=pt_10, EndPoint=pt_11)
pdecon = Deconstruct(Point=divide.Points)  # -> XComponent, YComponent, ZComponent
pt_12 = ConstructPoint(XCoordinate=0, YCoordinate=0, ZCoordinate=pdecon.ZComponent)
rotax = RotateAxis(Geometry=graft(ln), Angle=series, Axis=ln_2)  # -> flatten(Geometry), Transform
cir_2 = Circle(Plane=pt_12, Radius=pdecon.XComponent)
clean = CleanTree(RemoveNulls=True, RemoveInvalid=True, RemoveEmpty=False, Tree=rotax.Geometry)
lng = ListLength(List=cir_2)
join = JoinCurves(Curves=clean, Preserve=False)
subtraction = Subtraction(A=lng, B="2")
item = ListItem(List=cir_2, Index="0", Wrap=True)
cull_i = CullIndex(List=flatten(cir_2), Indices="0", Wrap=True)
lng_2 = ListLength(List=cull_i)
subtraction_2 = Subtraction(A=lng_2, B="2")
item_2 = ListItem(List=cir_2, Index=subtraction, Wrap=True)
divide_2 = DivideCurve(Curve=item, Count=radial_divisions, Kinks=False)  # -> Points, Tangents, Parameters
divide_3 = DivideCurve(Curve=item_2, Count=radial_divisions, Kinks=False)  # -> Points, Tangents, Parameters
cull_i_2 = CullIndex(List=cull_i, Indices=subtraction_2, Wrap=True)
shift_2 = ShiftList(List=divide_2.Points, Shift=1, Wrap=True)
shift_3 = ShiftList(List=divide_3.Points, Shift=1, Wrap=True)
divide_4 = DivideCurve(Curve=cull_i_2, Count=radial_divisions, Kinks=False)  # -> Points, Tangents, Parameters
ln_3 = Line(StartPoint=divide_2.Points, EndPoint=shift_2)
ln_4 = Line(StartPoint=divide_3.Points, EndPoint=shift_3)
shift_4 = ShiftList(List=divide_4.Points, Shift=1, Wrap=True)
ln_5 = Line(StartPoint=divide_4.Points, EndPoint=shift_4)
crv = Curve(ln_5)
crv_2 = Curve(ln_3)
crv_3 = Curve(ln_4)

sort = SortList(Keys=pdecon.ZComponent, ValuesA=divide.Points)  # -> Keys, ValuesA

panel_5 = Panel("Outer Columns")
item_3 = ListItem(List=sort.ValuesA, Index="1", Wrap=True)
pdecon_2 = Deconstruct(Point=item_3)  # -> XComponent, YComponent, ZComponent
pow = Power(A=pdecon_2.YComponent, B="2")
pow_2 = Power(A=pdecon_2.XComponent, B="2")
addition_2 = Addition(A=pow_2, B=pow)
pt_13 = ConstructPoint(XCoordinate=0, YCoordinate=0, ZCoordinate=0)
pow_3 = Power(A=addition_2, B="0.5")
cir_3 = Circle(Plane=pt_13, Radius=pow_3)
Z = UnitZ(Factor=1)
divide_5 = DivideCurve(Curve=cir_3, Count=radial_divisions, Kinks=False)  # -> Points, Tangents, Parameters
multiplication = Multiplication(A=Z, B=pdecon_2.ZComponent)
addition_3 = Addition(A=divide_5.Points, B=multiplication)
preview_2 = CustomPreview(Geometry=cir_3, Material="black")
ln_6 = Line(StartPoint=divide_5.Points, EndPoint=addition_3)

addition_4 = Addition(A=strut_node_connection, B="1")

lng_3 = ListLength(List=sort.ValuesA)
subtraction_3 = Subtraction(A=lng_3, B=addition_4)
item_4 = ListItem(List=sort.ValuesA, Index=subtraction_3, Wrap=True)
pdecon_3 = Deconstruct(Point=item_4)  # -> XComponent, YComponent, ZComponent
pow_4 = Power(A=pdecon_3.YComponent, B="2")
pow_5 = Power(A=pdecon_3.XComponent, B="2")
panel_6 = Panel("Central Struts")
pt_14 = ConstructPoint(XCoordinate=0, YCoordinate=0, ZCoordinate=pdecon_3.ZComponent)
addition_5 = Addition(A=pow_5, B=pow_4)
pow_6 = Power(A=addition_5, B="0.5")
cir_4 = Circle(Plane=pt_14, Radius=pow_6)
divide_6 = DivideCurve(Curve=cir_4, Count=number_of_struts, Kinks=False)  # -> Points, Tangents, Parameters
pt_15 = ConstructPoint(XCoordinate=0, YCoordinate=0, ZCoordinate=height_of_central_column)
ln_7 = Line(StartPoint=divide_6.Points, EndPoint=pt_15)

divide_7 = DivideCurve(Curve=cir_3, Count=radial_divisions, Kinks=False)  # -> Points, Tangents, Parameters
panel_7 = Panel("Bracing Members")
num_2 = Number([0, 1])
num_3 = Number([13, 14])
num_4 = Number([4, 5])
num_5 = Number([9, 10])
item_5 = ListItem(List=divide_7.Points, Index=num_4, Wrap=True)
item_6 = ListItem(List=divide_7.Points, Index=num_2, Wrap=True)
item_7 = ListItem(List=divide_7.Points, Index=num_3, Wrap=True)
item_8 = ListItem(List=divide_7.Points, Index=num_5, Wrap=True)
rev = ReverseList(List=item_7)
rev_2 = ReverseList(List=item_8)
rev_3 = ReverseList(List=item_5)
rev_4 = ReverseList(List=item_6)
Z_2 = UnitZ(Factor=1)
multiplication_2 = Multiplication(A=Z_2, B=pdecon_2.ZComponent)
addition_6 = Addition(A=rev_4, B=multiplication_2)
addition_7 = Addition(A=rev, B=multiplication_2)
addition_8 = Addition(A=rev_3, B=multiplication_2)
addition_9 = Addition(A=rev_2, B=multiplication_2)
ln_8 = Line(StartPoint=item_5, EndPoint=addition_8)
ln_9 = Line(StartPoint=item_7, EndPoint=addition_7)
ln_10 = Line(StartPoint=item_8, EndPoint=addition_9)
ln_11 = Line(StartPoint=item_6, EndPoint=addition_6)
pipe = Pipe(Curve=[ln_11, ln_8, ln_10, ln_9], Radius="0.1", Caps=0)

divide_8 = DivideCurve(Curve=cir_2, Count=radial_divisions, Kinks=False)  # -> Points, Tangents, Parameters
shift_5 = ShiftList(List=divide_8.Points, Shift=1, Wrap=True)
ln_12 = Line(StartPoint=divide_8.Points, EndPoint=shift_5)
crv_4 = Curve([ln_12, clean])
midpt = CurveMiddle(Curve=crv_4)
cullpt = CullDuplicates(Points=midpt, Tolerance=0.1, CullMode=1)  # -> Points, Indices, Valence
mat = CreateMaterial(Material_type="Fabric", Grade="Verseidag B15089")
item_9 = ListItem(List=crv_4, Index=cullpt.Indices, Wrap=True)
prop2d = Create2DProperty(Thickness_cm=Slider(5, range=0..10), Material=mat, Type="Shell", Unit="cm")
wbweave = WeaverbirdsMeshFromLinesWeaveBack(Lines=flatten(item_9), MaximumValence=4)
faceb = FaceBoundaries(Mesh=wbweave)
panel_8 = Panel("mesh creation")
disc = Discontinuity(Curve=faceb, Level=1)  # -> Points, Parameters
item_10 = ListItem(List=disc.Points, Index=0, Wrap=True)  # -> Item, Item1, Item2, Item3
srf4pt_2 = _4PointSurface(CornerA=item_10.Item, CornerB=item_10.Item1, CornerC=item_10.Item2, CornerD=item_10.Item3)
mem2d = Create2DMember(
    Brep=flatten(srf4pt_2),
    Property2D=prop2d,
    MeshSizeInModelUnits=Slider(0.5, range=0..1),
    InternalOffset="false",
    Preview3dSection=False,
    Mesh_mode="Quad dominant")

pt_16 = ConstructPoint(XCoordinate=0, YCoordinate=0, ZCoordinate=0)
pt_17 = ConstructPoint(XCoordinate=0, YCoordinate=0, ZCoordinate=height_of_central_column)
panel_9 = Panel("Central Column")
ln_13 = Line(StartPoint=pt_16, EndPoint=pt_17)

profile = CreateProfile(
    Depth_cm=Slider(45, range=0..100),
    Width_cm=Slider(45, range=0..100),
    catalogueIndex=-1,
    inclSS=False,
    lengthUnit="Centimeter",
    mode="Other",
    Profile_type="Rectangle",
    Measure="cm",
    typeIndex=-1)
mat_2 = CreateMaterial(Material_type="Timber", Grade="EN 338 C24")
section = CreateSection(Profile=profile, Material=mat_2, Basic_Offset="Centroid")

profile_2 = CreateProfile(
    Depth_cm=Slider(30, range=0..100),
    Width_cm=Slider(15, range=0..100),
    catalogueIndex=-1,
    inclSS=False,
    lengthUnit="Centimeter",
    mode="Other",
    Profile_type="Rectangle",
    Measure="cm",
    typeIndex=-1)
mat_3 = CreateMaterial(Material_type="Timber", Grade="EN 338 C24")
panel_11 = Panel("Gridshell Radials")
section_2 = CreateSection(Profile=profile_2, Material=mat_3, Basic_Offset="Centroid")

profile_3 = CreateProfile(
    Depth_cm=Slider(60, range=0..100),
    Width_cm=Slider(60, range=0..100),
    catalogueIndex=-1,
    inclSS=False,
    lengthUnit="Centimeter",
    mode="Other",
    Profile_type="Rectangle",
    Measure="cm",
    typeIndex=-1)
mat_4 = CreateMaterial(Material_type="Timber", Grade="EN 338 C24")
section_3 = CreateSection(Profile=profile_3, Material=mat_4, Basic_Offset="Centroid")

profile_4 = CreateProfile(
    Depth_cm=Slider(10, range=0..100),
    Width_cm=Slider(10, range=0..100),
    catalogueIndex=-1,
    inclSS=False,
    lengthUnit="Centimeter",
    mode="Other",
    Profile_type="Rectangle",
    Measure="cm",
    typeIndex=-1)
mat_5 = CreateMaterial(Material_type="Timber", Grade="EN 338 C24")
section_4 = CreateSection(Profile=profile_4, Material=mat_5, Basic_Offset="Centroid")

mat_6 = CreateMaterial(Material_type="Timber", Grade="EN 338 C24")
profile_5 = CreateProfile(
    Depth_cm=Slider(30, range=0..100),
    Width_cm=Slider(30, range=0..100),
    catalogueIndex=-1,
    inclSS=False,
    lengthUnit="Centimeter",
    mode="Other",
    Profile_type="Rectangle",
    Measure="cm",
    typeIndex=-1)
panel_14 = Panel("Inner Circle")
section_5 = CreateSection(Profile=profile_5, Material=mat_6, Basic_Offset="Centroid")

profile_6 = CreateProfile(
    Depth_cm=Slider(30, range=0..100),
    Width_cm=Slider(15, range=0..100),
    catalogueIndex=-1,
    inclSS=False,
    lengthUnit="Centimeter",
    mode="Other",
    Profile_type="Rectangle",
    Measure="cm",
    typeIndex=-1)
mat_7 = CreateMaterial(Material_type="Timber", Grade="EN 338 C24")
panel_15 = Panel("Gridshell Circles")
section_6 = CreateSection(Profile=profile_6, Material=mat_7, Basic_Offset="Centroid")

profile_7 = CreateProfile(
    Depth_cm=Slider(30, range=0..100),
    Width_cm=Slider(15, range=0..100),
    catalogueIndex=-1,
    inclSS=False,
    lengthUnit="Centimeter",
    mode="Other",
    Profile_type="Rectangle",
    Measure="cm",
    typeIndex=-1)
mat_8 = CreateMaterial(Material_type="Timber", Grade="EN 338 C24")
panel_16 = Panel("Outer Circle")
section_7 = CreateSection(Profile=profile_7, Material=mat_8, Basic_Offset="Centroid")

central_support = CreateSupport(Point=pt_16, Plane=PlaneXY(0, 0, 0), x=True, xx=True, y=True, yy=True, z=True, zz=True)
outer_supports = CreateSupport(Point=divide_5.Points, Plane=PlaneXY(0, 0, 0), x=True, xx=True, y=True, yy=True, z=True, zz=True)
gridshell_radial = Create1DMember(
    Curve=flatten(join),
    Property=section_2,
    Preview3dSection=False,
    x1=False,
    x2=False,
    xx1=True,
    xx2=True,
    y1=False,
    y2=False,
    yy1=True,
    yy2=True,
    z1=False,
    z2=False,
    zz1=True,
    zz2=True)
gridshell_circ = Create1DMember(
    Curve=flatten(crv),
    Property=section_6,
    Preview3dSection=False,
    x1=False,
    x2=False,
    xx1=True,
    xx2=True,
    y1=False,
    y2=False,
    yy1=True,
    yy2=True,
    z1=False,
    z2=False,
    zz1=True,
    zz2=True)
inner_circ = Create1DMember(
    Curve=flatten(crv_2),
    Property=section_5,
    Preview3dSection=False,
    x1=False,
    x2=False,
    xx1=False,
    xx2=False,
    y1=False,
    y2=False,
    yy1=False,
    yy2=False,
    z1=False,
    z2=False,
    zz1=False,
    zz2=False)
outer_circ = Create1DMember(
    Curve=flatten(crv_3),
    Property=section_7,
    Preview3dSection=False,
    x1=False,
    x2=False,
    xx1=True,
    xx2=True,
    y1=False,
    y2=False,
    yy1=True,
    yy2=True,
    z1=False,
    z2=False,
    zz1=True,
    zz2=True)
central_column = Create1DMember(
    Curve=flatten(ln_13),
    Property=section_3,
    Preview3dSection=False,
    x1=False,
    x2=False,
    xx1=False,
    xx2=False,
    y1=False,
    y2=False,
    yy1=False,
    yy2=False,
    z1=False,
    z2=False,
    zz1=False,
    zz2=False)
outer_columns = Create1DMember(
    Curve=flatten(ln_6),
    Property=section,
    Preview3dSection=False,
    x1=False,
    x2=False,
    xx1=False,
    xx2=True,
    y1=False,
    y2=False,
    yy1=False,
    yy2=True,
    z1=False,
    z2=False,
    zz1=False,
    zz2=True)
central_struts = Create1DMember(
    Curve=flatten(ln_7),
    Property=section_4,
    Preview3dSection=False,
    x1=False,
    x2=False,
    xx1=True,
    xx2=False,
    y1=False,
    y2=False,
    yy1=True,
    yy2=True,
    z1=False,
    z2=False,
    zz1=True,
    zz2=True)
panel_17 = Panel("member & support creation")

panel_18 = Panel("material/section properies")

preview3d = Preview3DSections(ElementMember1D2D=inner_circ)  # -> AnalysisLayerMesh, AnalysisLayerOutlines, DesignLayerMesh, DesignLayerOutlines
preview3d_2 = Preview3DSections(ElementMember1D2D=outer_circ)  # -> AnalysisLayerMesh, AnalysisLayerOutlines, DesignLayerMesh, DesignLayerOutlines
preview3d_3 = Preview3DSections(ElementMember1D2D=mem2d)  # -> AnalysisLayerMesh, AnalysisLayerOutlines, DesignLayerMesh, DesignLayerOutlines
preview3d_4 = Preview3DSections(ElementMember1D2D=central_struts)  # -> AnalysisLayerMesh, AnalysisLayerOutlines, DesignLayerMesh, DesignLayerOutlines
preview3d_5 = Preview3DSections(ElementMember1D2D=outer_columns)  # -> AnalysisLayerMesh, AnalysisLayerOutlines, DesignLayerMesh, DesignLayerOutlines
preview3d_6 = Preview3DSections(ElementMember1D2D=central_column)  # -> AnalysisLayerMesh, AnalysisLayerOutlines, DesignLayerMesh, DesignLayerOutlines
preview3d_7 = Preview3DSections(ElementMember1D2D=gridshell_circ)  # -> AnalysisLayerMesh, AnalysisLayerOutlines, DesignLayerMesh, DesignLayerOutlines
preview3d_8 = Preview3DSections(ElementMember1D2D=gridshell_radial)  # -> AnalysisLayerMesh, AnalysisLayerOutlines, DesignLayerMesh, DesignLayerOutlines
mcol = MeshColours(Mesh=preview3d_3.DesignLayerMesh, Colours="white")
mcol_2 = MeshColours(Mesh=preview3d_4.DesignLayerMesh, Colours="BurlyWood")
mcol_3 = MeshColours(Mesh=preview3d_5.DesignLayerMesh, Colours="BurlyWood")
mcol_4 = MeshColours(Mesh=preview3d_2.DesignLayerMesh, Colours="BurlyWood")
mcol_5 = MeshColours(Mesh=preview3d_7.DesignLayerMesh, Colours="BurlyWood")
mcol_6 = MeshColours(Mesh=preview3d.DesignLayerMesh, Colours="BurlyWood")
mcol_7 = MeshColours(Mesh=preview3d_6.DesignLayerMesh, Colours="BurlyWood")
mcol_8 = MeshColours(Mesh=preview3d_8.DesignLayerMesh, Colours="BurlyWood")
preview_3 = CustomPreview(Geometry=pipe, Material="gray")
preview_4 = CustomPreview(Geometry=preview3d_2.DesignLayerOutlines, Material="black")
preview_5 = CustomPreview(Geometry=preview3d.DesignLayerOutlines, Material="black")
preview_6 = CustomPreview(Geometry=preview3d_6.DesignLayerOutlines, Material="black")
preview_7 = CustomPreview(Geometry=preview3d_4.DesignLayerOutlines, Material="black")
preview_8 = CustomPreview(Geometry=preview3d_7.DesignLayerOutlines, Material="black")
preview_9 = CustomPreview(Geometry=preview3d_5.DesignLayerOutlines, Material="black")
preview_10 = CustomPreview(Geometry=preview3d_8.DesignLayerOutlines, Material="black")
panel_19 = Panel("Visulisations")

panel_20 = Panel("0.95")
num_6 = Number("-0.43")
division_2 = Division(A="-1.1", B="2")
multiplication_3 = Multiplication(A=pdecon_2.ZComponent, B=division_2)
beamload = CreateBeamLoad(
    Loadable1DObjects=outer_circ,
    Axis=0,
    Direction="x",
    Projected=False,
    Value_kN_m=multiplication_3,
    Type="Uniform",
    Unit="kN/m")
panel_21 = Panel("loads")
faceload = CreateFaceLoad(Loadable2DObjects=mem2d, Axis=-1, Direction="x", Projected=False, Value_kN_m²="-1.1", Type="Uniform", Unit="kN/m²")
faceload_2 = CreateFaceLoad(Loadable2DObjects=mem2d, Axis=-1, Direction="z", Projected=False, Value_kN_m²=num_6, Type="Uniform", Unit="kN/m²")
gravityload = CreateGravityLoad(GravityFactor=Vector(0, 0, -1))

analyse = AnalyseModel(
    GSAGeometryIn_m=flatten([outer_columns, outer_supports, central_support, central_column, central_struts, gridshell_circ, gridshell_radial, inner_circ, outer_circ, mem2d]),
    Load=flatten([gravityload, beamload, faceload, faceload_2]),
    Analyse=True,
    ReMesh=True,
    Tolerance=0.1,
    Unit="m")  # -> Model, Errors, Warnings, Remarks, Logs
getgeo = GetModelGeometry(GSAModel=analyse.Model, Mode=1, Unit="m")  # -> NodesIn_m, _1DElementsIn_m, _2DElementsIn_m, _3DElementsIn_m, _1DMembersIn_m, _2DMembersIn_m, _3DMembersIn_m, Assemblies
getres = GetResult(GSAModel=analyse.Model, T="A", Case=1)
an = Annotate(NodeElementMemberLoadResultDiagram=[getgeo._1DMembersIn_m, getgeo._2DMembersIn_m], Colour="black")  # -> Annotations, Position, Text
panel_22 = Panel("Analysis Results")
contour1d = Contour1DResults(
    Result=getres,
    IntermediatePoints=10,
    Scale=Slider(25, range=0..100),
    Display=3,
    Mode=4,
    energy="MJ",
    envelope="Absolute",
    force="kN",
    legend=True,
    legendScale=1,
    length="mm",
    moment="kN·m",
    noDec=0,
    Result_Type="Stress",
    Component="Bending, yy+",
    slider=False,
    stress="MPa",
    val=0,
    valMax=1000,
    valMin=0)  # -> L, Colours, LegendValues_MPa
mem1dforces = Member1DForcesAndMoments(Result=flatten(getres), IntermediatePoints=3, Max_Min="All", Force_Unit="kN", Moment_Unit="kN·m")  # -> ForceX_kN, ForceY_kN, ForceZ_kN, ForceYZ_kN, MomentXX_kN_m, MomentYY_kN_m, MomentZZ_kN_m, MomentYYZZ_kN_m
beamstress = BeamStresses(Result=getres, IntermediatePoints=3, Max_Min="Min Bending Y+", Unit="MPa")  # -> Axial_MPa, ShearY_MPa, ShearZ_MPa, BendingYVeZ_MPa, BendingYVeZ_MPa_2, BendingZVeY_MPa, BendingZVeY_MPa_2, CombinedC1_MPa, CombinedC2_MPa
